# Grasshopper definition orthosis.ghx (Grasshopper 1.0.8)

two = Number(2)
zero = Number(0)
one = Number(1)
rim_factor = Number(1.6)
caps_round = Integer(2)
false = Boolean(False)
forearm_circumference_mm = Slider(260, range=200..340)
wrist_circumference_mm = Slider(170, range=130..230)
length_mm = Slider(200, range=120..280)
strut_thickness_mm = Slider(3, range=1.5..5)
hoops_along_length = Slider(8, range=4..16)
ribs_around = Slider(12, range=6..24)
opening_angle_deg = Slider(290, range=200..330)
two_pi = Pi(Factor=two)
r_forearm = Division(A=forearm_circumference_mm, B=two_pi)
r_wrist = Division(A=wrist_circumference_mm, B=two_pi)
open_rad = Radians(Degrees=opening_angle_deg)
strut_r = Division(A=strut_thickness_mm, B=two)
rim_r = Multiplication(A=strut_r, B=rim_factor)
angle_domain = ConstructDomain(DomainStart=zero, DomainEnd=open_rad)
zero_to_one = ConstructDomain(DomainStart=zero, DomainEnd=one)
base_point = ConstructPoint(XCoordinate=zero, YCoordinate=zero, ZCoordinate=zero)
top_point = ConstructPoint(XCoordinate=zero, YCoordinate=zero, ZCoordinate=length_mm)
base_plane = XYPlane(Origin=base_point)
top_plane = XYPlane(Origin=top_point)
forearm_section = Arc(Plane=base_plane, Radius=r_forearm, Angle=angle_domain)  # -> Arc, Length
wrist_section = Arc(Plane=top_plane, Radius=r_wrist, Angle=angle_domain)  # -> Arc, Length
body_surface = Loft(
    Curves=[forearm_section.Arc, wrist_section.Arc],
    Options={Adjust=False, Closed=False, LoftEnds=0, LoftSimp=0, LoftType=0, Rebuild=10, Refit=0.01})
split_forearm = DivideCurve(Curve=forearm_section.Arc, Count=ribs_around, Kinks=false)  # -> Points, Tangents, Parameters
split_wrist = DivideCurve(Curve=wrist_section.Arc, Count=ribs_around, Kinks=false)  # -> Points, Tangents, Parameters
ribs = Line(StartPoint=split_forearm.Points, EndPoint=split_wrist.Points)
t_0_to_1 = Range(Domain=zero_to_one, Steps=hoops_along_length)
radius_delta = Subtraction(A=r_wrist, B=r_forearm)
delta_x_t = Multiplication(A=radius_delta, B=t_0_to_1)
hoop_radii = Addition(A=r_forearm, B=delta_x_t)
hoop_heights = Multiplication(A=length_mm, B=t_0_to_1)
hoop_centres = ConstructPoint(XCoordinate=zero, YCoordinate=zero, ZCoordinate=hoop_heights)
hoop_planes = XYPlane(Origin=hoop_centres)
hoops = Arc(Plane=hoop_planes, Radius=hoop_radii, Angle=angle_domain)  # -> Arc, Length
rim_curves = BrepEdges(Brep=body_surface)  # -> Naked, Interior, NonManifold
lattice_struts = Pipe(Curve=[ribs, hoops.Arc], Radius=strut_r, Caps=caps_round, FitRail=false)
rim = Pipe(Curve=rim_curves.Naked, Radius=rim_r, Caps=caps_round, FitRail=false)
orthosis = Merge(Data1=lattice_struts, Data2=rim)
print_mesh = MeshBrep(
    Brep=orthosis,
    Settings={GridMaxCount=0, GridMinCount=16, JaggedSeams=False, MaxEdgeLength=0, MinEdgeLength=0.0001, MinTolerance=0, Refine=True, RefineAngle=0, RelativeTolerance=0.65, SimplePlanes=True, Tolerance=0})
